# Grasshopper definition 0_end.gh (Grasshopper 1.0.7)

pipeline = GeometryPipeline(
    GroupByLayer=False,
    GroupByType=False,
    IncludeHidden=True,
    IncludeLocked=True,
    LayerFilter="Default",
    NameFilter="*",
    SublayerFiltering=True,
    TypeFilter=1)
python = GhPythonScript(x_num=Slider(10, range=0..10), y_num=Slider(10, range=0..10), spacing=Slider(2, range=0..10), attractor=pipeline)  # -> out, points, circles; inputs x_num: Int32, y_num: Int32, attractor: Point3d
# ---------- python: Python ----------
import Rhino.Geometry as rh


def calc_radius(d, r):
    
    if d < 2.5:
       radius = r * 0.5
    elif d < 5:
       radius = r
    else:
       radius = r * 2.0
    
    return radius


points = []
circles = []


for x in range(x_num):
    for y in range(y_num):
        
        pt = rh.Point3d(x, y, 0.0)
        
        points.append(pt)


for point in points:
    
    dist = point.DistanceTo(attractor)
    
    radius = calc_radius(dist, 0.5)
    
    circle = rh.Circle(point, radius)
    
    circles.append(circle)
# ---------- end python ----------
panel = Panel(python.circles)
