# Grasshopper definition 0_start.gh (Grasshopper 1.0.7)

pipeline = GeometryPipeline(
    GroupByLayer=False,
    GroupByType=False,
    IncludeHidden=True,
    IncludeLocked=True,
    LayerFilter="Default",
    NameFilter="*",
    SublayerFiltering=True,
    TypeFilter=1)
python = GhPythonScript(x_num=Slider(10, range=0..10), y_num=Slider(10, range=0..10), spacing=Slider(2, range=0..10), attractor=pipeline)  # -> out, points, circles; inputs x_num: Int32, y_num: Int32, attractor: Point3d
# ---------- python: Python ----------
import Rhino.Geometry as rh

points = []
circles = []

print("hello world!")
# ---------- end python ----------
panel = Panel(python.out)
